% Simulink data dictionary BusSystem.sldd

Control = Simulink.Bus()
  PowerLoad: Bus: LoadSetpoint
  AC1: Bus: LoadSetpoint
  AC2: Bus: LoadSetpoint
  AC3: Bus: LoadSetpoint
  InputVoltage: Bus: LoadSetpoint

Measurement = Simulink.Bus()
  PowerLoad: Bus: MeasPoint

LoadSetpoint = Simulink.Bus()
  LoadSetpoint: double

MeasPoint = Simulink.Bus()
  ILow: double
  IHigh: double
  VLow: double
  VHigh: double