% Simulink data dictionary FMUBus.sldd

Control = Simulink.Bus()
  PowerLoad: Bus: LoadSetpoint
  AC1: Bus: LoadSetpoint
  AC2: Bus: LoadSetpoint
  AC3: Bus: LoadSetpoint
  InputVoltage: Bus: LoadSetpoint

Measurement = Simulink.Bus()
  PowerLoad: Bus: PowerLoad

LoadSetpoint = Simulink.Bus()
  LoadSetpoint: double

PowerLoad = Simulink.Bus()
  Input: Bus: MeasPoint

MeasPoint = Simulink.Bus()
  ILow: double
  IHigh: double
  VLow: double
  VHigh: double