% Simulink data dictionary BusSystem.sldd

bus3 = Simulink.Bus()
  signal1: double
  Signal2: double

bus8 = Simulink.Bus()
  In1: double

bus9 = Simulink.Bus()
  In2: double

bus7 = Simulink.Bus()
  signal1: Bus: bus8
  Signal2: Bus: bus9

bus14 = Simulink.Bus()
  Input: double

bus11 = Simulink.Bus()
  signal1: Bus: bus8
  Signal2: Bus: bus9
  Signal3: Bus: bus14

bus20 = Simulink.Bus()
  signal1: Bus: bus3