% Simulink data dictionary BusSystem.sldd

slBus1 = Simulink.Bus()
  Grid: double

Example = Simulink.Bus()
  Signal1: double
  Signal2: double

slBus2 = Simulink.Bus()
  Height: double
  uctrl: double

Control = Simulink.Bus()
  ref: double
  uctrl: double
  Kpdmy: double
  Kidmy: double